# Grasshopper definition vizualize_pnts.ghx (Grasshopper 1.0.7)

panel = Panel("/Users/edvard/Documents/github/rob_fab_reach/_data")
number_slider = Slider(100, range=1..100)
list = ValueList({"Robot 1": "rob1", "Robot 2": "rob2", "Robot 3": "rob3", "Robot 1&2": "rob1,rob2", "Robot 1&3": "rob1,rob3", "Robot 2&3": "rob2,rob3", "Robot 1&2&3": "rob1,rob2,rob3"}, selected="Robot 1&2&3")

pt = Point("{-1.5,4.6,-0.4}")
pt_2 = Point("{4.3,0.3,3.4}")
box = Box2Pt(PointA=pt, PointB=pt_2, Plane=PlaneXY(0, 0, 0))
preview = CustomPreview(Geometry=box, Material=ColourSwatch(SwatchColor=RGBA(255, 0, 0, 64)))

pt_3 = Point("{1.7,0.3,-0.4}")
pt_4 = Point("{4.3,3.1,3.4}")
box_2 = Box2Pt(PointA=pt_3, PointB=pt_4, Plane=PlaneXY(0, 0, 0))
preview_2 = CustomPreview(Geometry=box_2, Material=ColourSwatch(SwatchColor=RGBA(255, 255, 0, 64)))

# ----
# volumes
panel_2 = Panel("search domain")
pt_5 = Point("{-1.5,-1.2,-0.4}")
pt_6 = Point("{4.3,3.1,3.4}")
box_3 = Box2Pt(PointA=pt_5, PointB=pt_6, Plane=PlaneXY(0, 0, 0))
preview_3 = CustomPreview(Geometry=box_3, Material=ColourSwatch(SwatchColor=RGBA(0, 34, 255, 64)))

panel_3 = Panel("collision mesh (ground)")
pt_7 = Point("{7,6,-0.375}")
pt_8 = Point("{-3,-3,-0.4}")
box_4 = Box2Pt(PointA=pt_8, PointB=pt_7, Plane=PlaneXY(0, 0, 0))

panel_4 = Panel("""-1.5 - 4.3 = 5.8
-1.2 - 4.6 = 5.8
-0.4 - 3.4 = 3.8""")
sint = SolidIntersection(BrepsA=box_3, BrepsB=box)
sdiff = SolidDifference(BrepsA=box_3, BrepsB=box)
sdiff_2 = SolidDifference(BrepsA=box, BrepsB=box_3)

data = Data(panel)
data_2 = Data(list)
data_3 = Data(number_slider)
python = GhPythonScript(path=data, rob_num=data_2, step_num=data_3, read_data=Toggle(True))  # -> points, values, vector; inputs step_num: Int32
# ---------- python: Python ----------
import os
import json
from compas_fab.utilities import read_data_from_json
from compas_fab.robots import Configuration


def initialize_count(rob_num):
    
    point_count = {}
    
    for rob in rob_num:
        print rob
        filename = '{}/{}_vec01_combined.json'.format(rob,rob)
        filepath = os.path.join(path, filename)
        
        print filepath
        
        with open(filepath, "r") as f:
            file_data = f.read()
            
        f.close()
        
        data = json.loads(file_data)
        point_count.update(data['results'])
        
        print len(point_count)
        
    for key in point_count:
        point_count[key] = 0
    
    return point_count


if read_data:
    
    rob_num = rob_num.split(",")
    point_count = initialize_count(rob_num)
    
    for rob in rob_num:
        print "read", rob
        filename = '{}/{}_vec{:0>2}_combined.json'.format(rob,rob,step_num)
        filepath = os.path.join(path, filename)
    
        with open(filepath, "r") as f:
            file_data = f.read()
            data = json.loads(file_data)
            f.close()
        
        for pnt,result in data['results'].items():
            if result:
                point_count[pnt] += 1
                    
    vector = data['vector']
    points = point_count.keys()
    values = point_count.values()
# ---------- end python ----------

# ----
# single direction reachability
swatch = ColourSwatch(SwatchColor=RGBA(0, 34, 255, 64))

# ----
# cumulative reachability
data_4 = Data(panel)
data_5 = Data(list)
data_6 = Data(number_slider)
python_2 = GhPythonScript(path=data_4, rob_num=data_5, step_num=data_6, read_data=Toggle(True))  # -> points, values, co_cnt_val, simplify(vectors); inputs step_num: Int32
# ---------- python_2: Python ----------
import os
import json
from compas_fab.utilities import read_data_from_json
from compas_fab.robots import Configuration

import ghpythonlib.treehelpers as th


def initialize_count(rob_num):
    
    point_count = {}
    
    for rob in rob_num:
        filename = '{}/{}_vec01_combined.json'.format(rob,rob)
        filepath = os.path.join(path, filename)
        
        #print rob,filepath
        
        with open(filepath, "r") as f:
            file_data = f.read()
            
        f.close()
        
        data = json.loads(file_data)
        point_count.update(data['results'])
        
        print len(point_count)
        
    for key in point_count:
        point_count[key] = 0
    
    return point_count

    

if read_data:
    
    rob_num = rob_num.split(",")
    
    point_count = initialize_count(rob_num)
    cooperative_count_save = initialize_count(rob_num)
    vectors = []
    
        
    for i in range(1,step_num+1):
        
        cooperative_count = initialize_count(rob_num)

        for rob in rob_num:
            print "{}: vector {}".format(rob,i)
            
            filename = '{}/{}_vec{:0>2}_combined.json'.format(rob,rob,i)
            filepath = os.path.join(path, filename)
            
            with open(filepath, "r") as f:
                file_data = f.read()
                data = json.loads(file_data)
                f.close()
                
                vec = data['vector']
                vectors.append(vec)
            
            for pnt,result in data['results'].items():
                if result:
                    cooperative_count[pnt] += 1
                    point_count[pnt] += 1
                    
        
        for pnt,result in cooperative_count.items():
            if result == len(rob_num):
                cooperative_count_save[pnt] = 1
            
        
    vectors = th.list_to_tree(vectors, source=[0,0])
    points = point_count.keys()
    values = point_count.values()
    
    co_cnt_val = cooperative_count_save.values()

    print points
# ---------- end python_2 ----------
pt_9 = Point(python_2.points)
int = Integer(python_2.values)
int_2 = Integer(python_2.co_cnt_val)
num = Number(python_2.vectors)

sint_2 = SolidIntersection(BrepsA=sint, BrepsB=box_2)
sdiff_3 = SolidDifference(BrepsA=sint, BrepsB=box_2)
preview_4 = CustomPreview(Geometry=sint_2, Material=ColourSwatch(SwatchColor=RGBA(255, 0, 0, 64)))  # disabled
preview_5 = CustomPreview(Geometry=sdiff_3, Material=ColourSwatch(SwatchColor=RGBA(255, 255, 0, 64)))  # disabled
preview_6 = CustomPreview(Geometry=[sdiff, sdiff_2], Material=swatch)  # disabled

int_3 = Integer(int)
data_7 = Data(number_slider)
data_8 = Data(list)
values = GhPythonScript(rob_num=data_8, values=int_3, n_steps=data_7)  # -> max_index, max_counts, counts; inputs values: list, n_steps: Int32
# ---------- values: Python ----------
counts = []

rob_num = rob_num.split(",")

max = n_steps * len(rob_num)

for i in range(0,max + 1):
    counts.append(values.count(i))

max_save = 0
for i,cnt in enumerate(counts):
    
    if cnt:
        max_index = i

max_counts = counts[max_index]
# ---------- end values ----------
panel_5 = Panel(values.counts)
panel_6 = Panel(values.max_index)
panel_7 = Panel(values.max_counts)
rec = DataRecorder(panel_7, DataLimit=-10, RecordData=False)

pt_10 = Point("{4.3,4.6,3.4}")
pt_11 = Point("{-1.5,-1.2,-0.4}")
box_5 = Box2Pt(PointA=pt_11, PointB=pt_10, Plane=PlaneXY(0, 0, 0))

dispatch = Dispatch(List=python.points, DispatchPattern=python.values)  # -> ListA, ListB
lng = ListLength(List=dispatch.ListA)
panel_8 = Panel(lng)
int_4 = Integer(Slider(0, range=0..3))
mindex = MemberIndex(Set=python.values, Member=int_4)  # -> Index, Count
item = ListItem(List=python.points, Index=mindex.Index, Wrap=True)
preview_7 = CustomPreview(Geometry=dispatch.ListA, Material=ColourSwatch(SwatchColor=RGB(0, 34, 255)))

panel_9 = Panel(python.vector)
item_2 = ListItem(List=python.vector, Index=0, Wrap=True)  # -> Item, Item1, Item2
pt_12 = ConstructPoint(XCoordinate=0, YCoordinate=0, ZCoordinate=0)
vec = VectorXYZ(XComponent=item_2.Item, YComponent=item_2.Item1, ZComponent=item_2.Item2)  # -> Vector, Length
vdisex = VectorDisplayEx(Point=pt_12, Vector=vec.Vector, Colour=ColourSwatch(SwatchColor=RGB(252, 167, 167)), Width="8")

panel_10 = Panel(rec)
arrbox = BoxArray(Geometry=pt_11, Cell=box_5, XCount=4, YCount=3, ZCount=2)  # -> Geometry, Transform

num_2 = Number(num)
flip = FlipMatrix(Data=num_2)
branch = TreeBranch(Tree=flip, Path="{1}", MaintainPaths=True)
branch_2 = TreeBranch(Tree=flip, Path="{2}", MaintainPaths=True)
branch_3 = TreeBranch(Tree=flip, Path="{0}", MaintainPaths=True)
pt_13 = ConstructPoint(XCoordinate=6, YCoordinate=-2, ZCoordinate=0)
vec_2 = VectorXYZ(XComponent=branch_3, YComponent=branch, ZComponent=branch_2)  # -> Vector, Length
vdisex_2 = VectorDisplayEx(Point=pt_13, Vector=vec_2.Vector, Colour=RGB(0, 0, 0), Width="1")

pt_14 = Point(pt_9)
panel_11 = Panel(panel_6)
int_5 = Integer(python_2.values)
gradient = Gradient(
    LowerLimit="0",
    UpperLimit=panel_11,
    Parameter=int_5,
    stops=[0: RGB(255, 255, 255), 0.1: RGB(236, 27, 60), 0.2: RGB(210, 0, 118), 0.3: RGB(103, 0, 120), 0.4: RGB(39, 72, 161), 0.5: RGB(1, 192, 229), 0.6: RGB(18, 178, 90), 0.7: RGB(79, 186, 8), 0.8: RGB(220, 237, 32), 0.9: RGB(247, 159, 20), 1: RGB(243, 57, 0)])
gradient_2 = Gradient(
    LowerLimit="0",
    UpperLimit=panel_11,
    Parameter=int_5,
    stops=[0: RGB(255, 255, 255), 0.8: RGB(255, 0, 0), 0.986: RGB(145, 0, 0), 1: RGB(0, 0, 0)])
preview_8 = CustomPreview(Geometry=pt_14, Material=gradient)

pt_15 = Point(pt_9)
int_6 = Integer(int_2)
int_7 = Integer(int)
int_8 = Integer(int_2)
dispatch_2 = Dispatch(List=pt_15, DispatchPattern=int_6)  # -> ListA, ListB
dispatch_3 = Dispatch(List=int_7, DispatchPattern=int_8)  # -> ListA, ListB
panel_12 = Panel(panel_6)
gradient_3 = Gradient(
    LowerLimit="0",
    UpperLimit=panel_12,
    Parameter=dispatch_3.ListA,
    stops=[0: RGB(255, 255, 255), 0.1: RGB(236, 27, 60), 0.2: RGB(210, 0, 118), 0.3: RGB(103, 0, 120), 0.4: RGB(39, 72, 161), 0.5: RGB(1, 192, 229), 0.6: RGB(18, 178, 90), 0.7: RGB(79, 186, 8), 0.8: RGB(220, 237, 32), 0.9: RGB(247, 159, 20), 1: RGB(243, 57, 0)])
pt_16 = Point(dispatch_2.ListA)
preview_9 = CustomPreview(Geometry=pt_16, Material=gradient_3)

pt_17 = Point(pt_9)
int_9 = Integer(int)
int_10 = Integer("0")
mindex_2 = MemberIndex(Set=int_9, Member=int_10)  # -> Index, Count
item_3 = ListItem(List=pt_17, Index=mindex_2.Index, Wrap=True)
preview_10 = CustomPreview(Geometry=item_3, Material=ColourSwatch(SwatchColor=RGB(0, 34, 255)))

pt_18 = Point(pt_9)
int_11 = Integer(int)
panel_13 = Panel(panel_6)
int_12 = Integer(panel_13)
mindex_3 = MemberIndex(Set=int_11, Member=int_12)  # -> Index, Count
item_4 = ListItem(List=pt_18, Index=mindex_3.Index, Wrap=True)
preview_11 = CustomPreview(Geometry=item_4, Material=ColourSwatch(SwatchColor=RGB(0, 0, 0)))

int_13 = Integer(int)
pt_19 = Point(pt_9)
panel_14 = Panel(panel_6)
multiplication = Multiplication(A=panel_14, B=Slider(0.02, range=0..1))
larger = LargerThan(FirstNumber=int_13, SecondNumber=multiplication)  # -> LargerThan, OrEqualTo
dispatch_4 = Dispatch(List=pt_19, DispatchPattern=larger.OrEqualTo)  # -> ListA, ListB
preview_12 = CustomPreview(Geometry=dispatch_4.ListA, Material=ColourSwatch(SwatchColor=RGB(217, 80, 80)))

preview_13 = CustomPreview(Geometry=dispatch.ListB, Material=ColourSwatch(SwatchColor=RGB(0, 0, 0)))
